# Grasshopper definition rhinovisual.gh (Grasshopper 1.0.7)

path = FilePath("D:\Dropbox\Dropbox\01PHD\13. TTÜ tunnid\3. Data processing\GitHub\Data Processing\DataProcess\Data analyser\rhinofile.txt")
file = ReadFile(File=path, PerLineParse=True)
panel = Panel(file)
nurbs_curve = NurbsCurve(Vertices=panel, Degree=3, Periodic=False)  # -> Curve, Length, Domain
curve = Curve(nurbs_curve.Curve)
